# Grasshopper definition Circles On Sphere.gh (Grasshopper 1.0.7)

points_count = Slider(96, range=0..100)
points_count_2 = GetInteger(points_count, AtLeast=1, AtMost=1, Maximum=2147483647, Minimum=1, Prompt="Please set the count of circles on the sphere")
range = Range(Domain="-1 To 1", Steps=expr("x - 1", points_count_2))
series = Series(Start=0, Step="Pi * (3 - sqrt(5))", Count=points_count_2)
expression = Expression(x=range, Expression="sqrt(1 - x ^ 2)")
cos = Cosine(Value=series)
sin = Sine(Value=series)
sphere_radius = GetNumber(Slider(8, range=0..10), AtLeast=1, AtMost=1, Maximum=1.797693135e+308, Minimum=0, Prompt="Please set the Sphere Radius")
circle_radius = GetNumber(Slider(1, range=0..10), AtLeast=1, AtMost=1, Maximum=1.797693135e+308, Minimum=0, Prompt="Please set the Circle Radius")
multiplication = Multiplication(A=expression, B=cos)
multiplication_2 = Multiplication(A=expression, B=sin)
pt = ConstructPoint(XCoordinate=multiplication, YCoordinate=multiplication_2, ZCoordinate=range)
sph = Sphere(Base=PlaneXY(0, 0, 0), Radius=sphere_radius)
multiplication_3 = Multiplication(A=pt, B=sphere_radius)
srf_cp = SurfaceClosestPoint(Point=multiplication_3, Surface=sph)  # -> Point, UVPoint, Distance
evalsrf = EvaluateSurface(Surface=sph, Point=srf_cp.UVPoint)  # -> Point, Normal, UDirection, VDirection, Frame
cir = Circle(Plane=evalsrf.Frame, Radius=circle_radius)

# ---- group: RH_OUT:Sphere
srf = Surface(sph)

# ---- group: RH_OUT:Circles
circle = Circle(cir)

# ----
context_bake = ContextBake(Geometry=[srf, circle])
